# Grasshopper definition 240420_EmptyFile_BestPractice.gh (Grasshopper 1.0.7)

# READ ME
# Note(s): 1. Make sure the Rhino project is in "mm".
# Tested In: YYMMDD_In Rhino 7_weiwin.loy@hdr.qut.edu.au.
package_s_needed = Panel("Plugin Name (website)")

# ----
# USER INPUTS
# Category Name
# 01
d_workstation = Slider(700, range=0..10000)
d_induction01 = Slider(600, range=0..1000)
d_induction02 = Slider(800, range=0..1000)
d_induction03 = Slider(900, range=0..1000)
d_induction04 = Slider(2700, range=0..10000)

# ----
# AUTOMATIC INPUTS
# HELPERS
# PROCESSING FUNCTIONS
# MAIN FUNCTION
# UI / OUTPUTS
# Title Name
merge = Merge(Data1=d_workstation, Data2=d_induction01, Data3=d_induction02, Data4=d_induction03, Data5=d_induction04)
