# Grasshopper definition 240420_Completed_Base Robot Program.gh (Grasshopper 1.0.7)
# plug-ins: Robots, Pufferfish

# ----
# USER INPUTS
# BASIC PARAMETERS
# Package(s) Needed: Robot - version 1.70 (https://www.food4rhino.com/en/app/robots )
# READ ME
# 00
# Note(s): 1. Make sure the Rhino project is in "mm".
# 3. Connect to the same network as the robots.
# Tested In: YYMMDD_In Rhino 7_weiwin.loy@hdr.qut.edu.au.
robots_library = RobotsLibrary(
    {"UR3e", "UR5e", "UR10e", "UR16e", "UR3", "UR5", "UR10", "UR3e", "UR5e", "UR10e", "UR16e", "UR3", "UR5", "UR10"}, selected="UR10",
    Type=0)

# ---- group: What is the motion type?
# 02
# Established Robot Trajectory Parameters
list = ValueList({"Joint", "Linear"}, selected="Joint")
input_robotmotion = Data(list)

# ----
point_b = Point(Point(249.9922658, -761.8939306, 280))
# 01
point_a = Point(Point(-647.0883877, -624.1733199, 280))

# ---- group: How robot configured?
list_2 = FlagFields({"Shoulder": 1, "Elbow": 2, "Wrist": 4}, selected="Shoulder")
input_robotconfiguration = Data(list_2)

# ---- group: How fast does the robot going to move?
input_robot_speed_mm_s = Slider(55, range=30..80)

# ---- group: INPUT | PARAMETER
input_toolname = Data("RobotiqGripper")
output_tcp = Data(PlaneXY(0, 0, 190))
input_toolweight_kg = Data(1.87)
# 03
mesh_toolgeometry = Data(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)

# ----
# Established Robot Waypoints
xy_plane = XYPlane(Origin=point_a)
flip_plane = FlipPlane(Plane=xy_plane, FlipX=False, FlipY=False, FlipZ=True)  # -> Flipped, ResultBoolean

xy_plane_2 = XYPlane(Origin=point_b)
flip_plane_2 = FlipPlane(Plane=xy_plane_2, FlipX=False, FlipY=False, FlipZ=True)  # -> Flipped, ResultBoolean

# ----
# AUTOMATIC INPUTS
# Robot Type?
load_robot_system = LoadRobotSystem(Name=robots_library, Base=PlaneXY(0, 0, 0))
# HELPERS
output_robottype = Data(load_robot_system)

# ---- group: SPECIFY END-EFFECTOR GEOMETRY
tool = CreateTool(Name=input_toolname, TCP=output_tcp, Weight=input_toolweight_kg, Mesh=mesh_toolgeometry)  # -> Tool, TCP
input_robot_endeffectortool = Data(tool.Tool)

# ---- group: How fast does the robot going to move?
create_speed = CreateSpeed(
    Translation=input_robot_speed_mm_s,
    Rotation=3.141592654,
    ExternalTranslation=5000,
    ExternalRotation=18.84955592,
    AccelTranslation=2500,
    AccelAxis=12.56637061)
input_robotspeed = Data(create_speed)

# ----
merge = Merge(Data1=flip_plane.Flipped, Data2=flip_plane_2.Flipped)
input_pointa_to_point_b = Data(merge)

input_robot_endeffectortool_2 = Data(input_robot_endeffectortool)
input_pointa_to_point_b_2 = Data(input_pointa_to_point_b)
input_robotconfiguration_2 = Data(input_robotconfiguration)
input_robotmotion_2 = Data(input_robotmotion)
input_robotspeed_2 = Data(input_robotspeed)

# ----
# Compiler into Robot Language
create_target = CreateTarget(
    Plane=input_pointa_to_point_b_2,
    RobConf=input_robotconfiguration_2,
    Motion=input_robotmotion_2,
    Tool=input_robot_endeffectortool_2,
    Speed=input_robotspeed_2,
    IsCartesian=True)
output_robottarget = Data(create_target)

input_uploadprogram = Button()
input_playprogram = Button()
input_pauseprogram = Button()
input_robotip = Panel("192.168.3.36")

output_robottarget_2 = Data(output_robottarget)
# PROCESSING FUNCTIONS
# CREATE PROGRAM & SENT IT
# 00
output_robottype_2 = Data(output_robottype)

# ----
# MAIN FUNCTION
# Create Basic Program
create_program = CreateProgram(Name="CAADRIA2024_Day01_StarterScript", RobotSystem=output_robottype_2, Targets=output_robottarget_2, StepSize=1)  # -> Program, Code, Duration, Warnings, Errors
# UI / OUTPUTS
output_program = Data(create_program.Program)

# ----
# 01
output_program_2 = Data(output_program)
# Sent it Robot
remote_connection = RemoteConnection(Program=output_program_2, IP=input_robotip, Upload=input_uploadprogram, Play=input_playprogram, Pause=input_pauseprogram)
panel = Panel(remote_connection)

# ----
# VISUALISE ISSUE IN COMPUTER
output_program_3 = Data(output_program)

program_simulation = ProgramSimulation(Program=output_program_3, Time=Slider(0, range=0..1), Normalized=True)  # -> SystemMeshes, JointRotations, Plane, Index, Time, Program, Errors
output_systemmeshes = Data(program_simulation.SystemMeshes)
