# Grasshopper definition 240421_Completed_AR-enabled Robot Program.gh (Grasshopper 1.0.7)
# plug-ins: Robots, Fologram for Grasshopper, Pufferfish

# AUTOMATIC INPUTS
# USER INPUTS
# BASIC PARAMETERS
# Package(s) Needed: Robot (https://www.food4rhino.com/en/app/robots)
# Fologram (https://fologram.com/)
# READ ME
# Note(s): 1. Make sure the Rhino project is in "mm".
# 3. Connect to the same network as the robots.
augdoc = AugmentedDocument(augmented_trigger_0_key=number_slider_4, num_augmented_triggers=1)

input_offsetplane = Data(Slider(120, range=0..1000))

# ----
# 01a
point_a = Point(Point(-528.712845, -826.0427479, 433.7107766))

point_b = Point(Point(249.9922658, -890.6679402, 280))

# ----
# 00
# Tested In: YYMMDD_In Rhino 7_weiwin.loy@hdr.qut.edu.au.
robots_library = RobotsLibrary(
    {"UR3e", "UR5e", "UR10e", "UR16e", "UR3", "UR5", "UR10", "UR3e", "UR5e", "UR10e", "UR16e", "UR3", "UR5", "UR10"}, selected="UR10",
    Type=0)

# ---- group: What is the motion type?
# Established Robot Trajectory Parameters
list = ValueList({"Joint", "Linear"}, selected="Linear")
input_robotmotion = Data(list)

# ---- group: How robot configured?
list_2 = FlagFields({"Shoulder": 1, "Elbow": 2, "Wrist": 4}, selected="Shoulder")
input_robotconfiguration = Data(list_2)

# ---- group: How fast does the robot going to move?
input_robot_speed_mm_s = Slider(55, range=30..80)

# ---- group: INPUT | PARAMETER
input_toolname = Data("RobotiqGripper")
output_tcp = Data(PlaneXY(0, 0, 190))
input_toolweight_kg = Data(1.87)
# 04
mesh_toolgeometry = Data(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)

# ----
# Robot Type?
load_robot_system = LoadRobotSystem(Name=robots_library, Base=PlaneXY(0, 0, 0))
# HELPERS
output_robottype = Data(load_robot_system)

# ---- group: SPECIFY END-EFFECTOR GEOMETRY
tool = CreateTool(Name=input_toolname, TCP=output_tcp, Weight=input_toolweight_kg, Mesh=mesh_toolgeometry)  # -> Tool, TCP
input_robot_endeffectortool = Data(tool.Tool)

# ----
# Established Waypoint 01
xy_plane = XYPlane(Origin=point_b)
input_buttonplane_pln = Data(xy_plane)

interaction_type = InteractionType(7)
input_buttonplane_pln_2 = Data(input_buttonplane_pln)
number_slider = Slider(50, range=1..100)
center_box = CenterBox(Base=input_buttonplane_pln_2, X=number_slider, Y=number_slider, Z=number_slider)

# ----
# Established Waypoint 01
xy_plane_2 = XYPlane(Origin=point_a)
input_buttonplane_pln_3 = Data(xy_plane_2)

input_buttonplane_pln_4 = Data(input_buttonplane_pln_3)
interaction_type_2 = InteractionType(7)
number_slider_2 = Slider(50, range=1..100)
center_box_2 = CenterBox(Base=input_buttonplane_pln_4, X=number_slider_2, Y=number_slider_2, Z=number_slider_2)

# ---- group: How fast does the robot going to move?
create_speed = CreateSpeed(
    Translation=input_robot_speed_mm_s,
    Rotation=3.141592654,
    ExternalTranslation=5000,
    ExternalRotation=18.84955592,
    AccelTranslation=2500,
    AccelAxis=12.56637061)
input_robotspeed = Data(create_speed)

# ----
sync_geometry = SyncGeometry(Geometry=center_box, Interactions=interaction_type)
output_syncedb = Data(sync_geometry)

output_syncedb_fologram = Data(output_syncedb)

mesh = Mesh(output_syncedb_fologram)
volume = Volume(Geometry=mesh)  # -> Volume, Centroid
plane_origin = PlaneOrigin(Base=output_syncedb_fologram, Origin=volume.Centroid)
flip_plane = FlipPlane(Plane=plane_origin, FlipX=False, FlipY=False, FlipZ=True)  # -> Flipped, ResultBoolean
output_syncedb_pln = Plane(flip_plane.Flipped)

output_syncedb_pln_2 = Plane(output_syncedb_pln)
input_offsetplane_2 = Data(input_offsetplane)

plane_offset = PlaneOffset(BasePlane=output_syncedb_pln_2, Offset=expr("-x", input_offsetplane_2))
output_syncedb_offsetpln = Plane(plane_offset)

sync_geometry_2 = SyncGeometry(Geometry=center_box_2, Interactions=interaction_type_2)
output_synceda = Data(sync_geometry_2)

output_synceda_fologram = Data(output_synceda)

mesh_2 = Mesh(output_synceda_fologram)
volume_2 = Volume(Geometry=mesh_2)  # -> Volume, Centroid
plane_origin_2 = PlaneOrigin(Base=output_synceda_fologram, Origin=volume_2.Centroid)
flip_plane_2 = FlipPlane(Plane=plane_origin_2, FlipX=False, FlipY=False, FlipZ=True)  # -> Flipped, ResultBoolean
output_synceda_pln = Plane(flip_plane_2.Flipped)

output_synceda_pln_2 = Plane(output_synceda_pln)
# 01b
input_offsetplane_3 = Data(input_offsetplane)

plane_offset_2 = PlaneOffset(BasePlane=output_synceda_pln_2, Offset=expr("-x", input_offsetplane_3))
output_synceda_offsetpln = Plane(plane_offset_2)

output_synceda_offsetpln_2 = Plane(output_synceda_offsetpln)
output_syncedb_offsetpln_2 = Plane(output_syncedb_offsetpln)
# 02
output_synceda_pln_3 = Plane(output_synceda_pln)
# 03
output_syncedb_pln_3 = Plane(output_syncedb_pln)

# ----
# Established Robot Waypoints
merge = Merge(
    Data1=output_synceda_pln_3,
    Data2=output_synceda_offsetpln_2,
    Data3=output_syncedb_offsetpln_2,
    Data4=output_syncedb_pln_3)
input_pointa_to_point_b = Data(merge)

input_robot_endeffectortool_2 = Data(input_robot_endeffectortool)
input_pointa_to_point_b_2 = Data(input_pointa_to_point_b)
input_robotconfiguration_2 = Data(input_robotconfiguration)
input_robotmotion_2 = Data(input_robotmotion)
input_robotspeed_2 = Data(input_robotspeed)

# ----
# Compiler into Robot Language
create_target = CreateTarget(
    Plane=input_pointa_to_point_b_2,
    RobConf=input_robotconfiguration_2,
    Motion=input_robotmotion_2,
    Tool=input_robot_endeffectortool_2,
    Speed=input_robotspeed_2,
    IsCartesian=True)
output_robottarget = Data(create_target)

# ----
# PROCESSING FUNCTIONS
# CREATE PROGRAM & SENT IT
# 00
output_robottype_2 = Data(output_robottype)
output_robottarget_2 = Data(output_robottarget)

# ----
# MAIN FUNCTION
# Create Basic Program
create_program = CreateProgram(Name="CAADRIA2024_Day01_StarterScript", RobotSystem=output_robottype_2, Targets=output_robottarget_2, StepSize=1)  # -> Program, Code, Duration, Warnings, Errors
# UI / OUTPUTS
output_program = Data(create_program.Program)

# ----
# Interactive Button
construct_point = ConstructPoint(
    XCoordinate=Slider(1000, range=-1000..1000),
    YCoordinate=Slider(-115, range=-1000..1000),
    ZCoordinate=Slider(188, range=-1000..1000))
xy_plane_3 = XYPlane(Origin=construct_point)
input_buttonplane_pln_5 = Data(xy_plane_3)

input_buttonplane_pln_6 = Data(input_buttonplane_pln_5)
number_slider_3 = Slider(66, range=1..100)

center_box_3 = CenterBox(Base=input_buttonplane_pln_6, X=number_slider_3, Y=number_slider_3, Z=number_slider_3)
output_buttongeometry = Data(center_box_3)

interaction_type_3 = InteractionType(1)
output_buttongeometry_2 = Data(output_buttongeometry)

sync_geometry_3 = SyncGeometry(Geometry=output_buttongeometry_2, Material=ColourSwatch(SwatchColor=RGB(45, 113, 186)), Interactions=interaction_type_3)
output_syncedbutton = Data(sync_geometry_3)

output_syncedbutton_2 = Data(output_syncedbutton)

on_tap = OnTap(SyncGeometry=output_syncedbutton_2)  # -> Enabled, Interactor
output_bool_ispressed = Data(on_tap.Enabled)

input_playprogram = Button()
# 02
input_pauseprogram = Button()
output_bool_ispressed_2 = Data(output_bool_ispressed)
input_robotip = Panel("192.168.1.180")

# ----
# 01
output_program_2 = Data(output_program)
# Sent it Robot
remote_connection = RemoteConnection(
    Program=output_program_2,
    IP=input_robotip,
    Upload=output_bool_ispressed_2,
    Play=input_playprogram,
    Pause=input_pauseprogram)  # disabled
panel = Panel(remote_connection)

# ----
# VISUALISE ISSUE IN COMPUTER
output_program_3 = Data(output_program)
number_slider_4 = Slider(0, range=0..1)

program_simulation = ProgramSimulation(Program=output_program_3, Time=number_slider_4, Normalized=True)  # -> SystemMeshes, JointRotations, Plane, Index, Time, Program, Errors
output_robotmesh = Data(program_simulation.SystemMeshes)

output_robotmesh_2 = Data(output_robotmesh)
sync_geometry_4 = SyncGeometry(Geometry=output_robotmesh_2, Material=ColourSwatch(SwatchColor=RGBA(255, 255, 255, 86)))
